# Requirement set MBSE_Gruppe_3_E_Scooter (R2025b)

## 1 [MBSE Gruppe 3 - E-Scooter] References to MBSE Gruppe 3 - E-Scooter.docx (Container)
Read-only references to Microsoft Word document.

### 1.1 [1. Fahrzeugtechnische Anforderungen (§ 1 - § 3)]

#### 1.1.1 [EKF-01: Bauartbedingte Höchstgeschwindigkeit]
Zusammenfassung: Geschwindigkeit zwischen 6 km/h und 20 km/h.
Beschreibung: Das Fahrzeug muss eine bauartbedingte Höchstgeschwindigkeit von nicht weniger als 6 km/h und nicht mehr als 20 km/h aufweisen.
Rationale: § 1 Abs. 1 eKFV.

#### 1.1.2 [EKF-02: Nenndauerleistung]
Zusammenfassung: Leistungsbegrenzung 500W / 1400W.
Beschreibung: Die Nenndauerleistung darf 500 Watt nicht überschreiten (1400 Watt bei selbstbalancierenden Fahrzeugen mit mindestens 60 % Stabilisierungsanteil).
Norm: DIN EN 15194 / UNECE R85.
EKF-03: Abmessungen und Masse
Zusammenfassung: Max. 55kg Masse und definierte Maße.
Beschreibung: Gesamtbreite max. 700 mm, Gesamthöhe max. 1400 mm, Gesamtlänge max. 2000 mm. Fahrzeugmasse ohne Fahrer maximal 55 kg.
2. Sicherheitstechnische Systeme (§ 4 - § 7)
Parent-Sektion für die aktiven und passiven Sicherheitssysteme.
EKF-04: Verzögerungseinrichtung (Bremsen)
Zusammenfassung: Zwei unabhängige Bremsen mit 3,5 m/s².
Beschreibung: Das Fahrzeug muss mit zwei voneinander unabhängigen Bremsen ausgerüstet sein, die bis zur Maximalgeschwindigkeit wirken und eine Verzögerung von mindestens 3,5 m/s² erreichen.
EKF-05: Lichttechnische Einrichtungen
Zusammenfassung: Beleuchtung nach StVZO.
Beschreibung: Ausrüstung mit Scheinwerfer (weiß), Schlussleuchte (rot) und seitlichen gelben Rückstrahlern (oder weißen Reflexstreifen an Reifen/Felgen).
Norm: UNECE R50.
EKF-06: Totmann-Schalter (Antriebsdeaktivierung)
Zusammenfassung: Motor-Nullstellung innerhalb von 1 Sekunde.
Beschreibung: Das Bedienelement zur Steuerung der Motorleistung muss sich innerhalb einer Sekunde selbstständig in Nullstellung zurückstellen, wenn der Fahrer es loslässt.
3. Prüfbedingungen und Fahrdynamik (Anlage)
Diese Sektion definiert die Testumgebung für die Verifikation.
ANL-01: Umgebungsbedingungen für Tests
Zusammenfassung: Temperatur und Untergrund.
Beschreibung: Prüfungen auf ebener, trockener Beton-/Asphaltoberfläche. Steigung <= 1%. Temperatur zwischen 0 °C und 45 °C. Akkuladestand >= 75 %.
ANL-02: Dynamische Stabilität (Hindernisse)
Zusammenfassung: Überfahren von Kanten und Vertiefungen.
Beschreibung: Stabiles Überfahren einer 3 cm Bordsteinkante (Winkel 90° und 45°) sowie Durchfahren einer 5 cm tiefen Vertiefung bei Höchstgeschwindigkeit.
4. Technische Referenznormen
Zusätzliche Industrienormen für die Detailauslegung.
NORM-01: Elektromagnetische Verträglichkeit (EMV)
Beschreibung: Nachweis der Störfestigkeit und Emissionsgrenzwerte gemäß UNECE Regelung Nr. 10.
NORM-02: Funktionale Sicherheit (ISO 13849)
Beschreibung: Auslegung sicherheitskritischer Funktionen (Bremse/Gas) nach dem Stand der Technik (Performance Level r).

#### 1.1.3 [Quellen: eKFV: https://www.geset] Quellen: eKFV: https://www.gesetze-im-internet.de/ekfv/BJNR075610019.html

### 1.2 [1. Übergeordnetes Systemziel]
Der Kunde wünscht sich ein leichtes, modernes, zuverlässiges und benutzerfreundliches Fahrzeug für den Stadtverkehr, das alltägliche Mobilität mit modernen digitalen Funktionen (wie einer App) vereint und ein sicheres Fahrgefühl bietet.

### 1.3 [2. Funktionale Anforderung]
Das Fahrzeug muss vollständig elektrisch durch einen Elektromotor angetrieben werden
Der Roller muss mit einem übersichtlichen Display ausgestattet sein, das den aktuellen Akkustand, die aktuelle Geschwindigkeit und die Leistungsabgabe anzeigt
Es muss eine begleitende Smartphone-App vorhanden sein, die den Standort des Rollers trackt und grundlegende Fahrzeuginformationen anzeigt
Das System muss über eine Diebstahlschutz-Funktion verfügen, die vor unerlaubter Nutzung schützt
Das Fahrzeug muss mit leicht zugänglichen Bedienelementen und einer Klingel ausgestattet sein

### 1.4 [3. Nichtfunktionale Anforderungen]
Der Roller muss leicht und kompakt aufgebaut sein, sodass er gut manövrierbar bleibt und einfach transportiert werden kann.
Die Bedienelemente müssen leicht zugänglich sein und eine intuitive Nutzung während der Fahrt ermöglichen.
Die Reichweite des Akkus muss so ausgelegt sein, dass typische Tagesstrecken (mehrere Fahrten) ohne zwischenzeitliches Aufladen bewältigt werden können.
Fahrdynamik: Das Fahrzeug soll schnell reagieren und sich stabil fahren lassen.
Usability:
Fahrverhalten: Das System muss ein stabiles Fahrgefühl bieten und schnell auf Lenk- und Bremsbefehle reagieren.
Reichweite: Das System muss eine ausreichende Reichweite für typische Tagesstrecken im urbanen Raum ohne Zwischenladung bieten.